% Simulink data dictionary Problem4_data.sldd

J = Simulink.Parameter(3.2284e-6)
b = Simulink.Parameter(3.5077e-6)
Ke = Simulink.Parameter(0.0274)
Kt = Simulink.Parameter(0.0274)
R = Simulink.Parameter(4)
L = Simulink.Parameter(2.75e-6)
Ts = Simulink.Parameter(0.0001)
Ki = Simulink.Parameter(500)
Kp = Simulink.Parameter(40)